# Dynamo graph Data extraction of categories with required parameter.dyn (Dynamo 3.0.3.7597)

python_script = Python()  # CPython3; unwired: IN[0]
# ---------- python_script.python (55 lines) ----------
# Load the Python Standard and DesignScript Libraries
import sys
import clr
clr.AddReference('ProtoGeometry')
from Autodesk.DesignScript.Geometry import *

# The inputs to this node will be stored as a list in the IN variables.
dataEnteringNode = IN

# Place your code below this line

import clr
clr.AddReference('RevitServices')
clr.AddReference('RevitAPI')
clr.AddReference('RevitNodes')

from RevitServices.Persistence import DocumentManager
from Autodesk.Revit.DB import FilteredElementCollector, BuiltInCategory, Element, ElementId

# Access the current Revit document
doc = DocumentManager.Instance.CurrentDBDocument

# Get all categories in the document
categories = doc.Settings.Categories

# Dictionary to store parameters by category
category_parameters = {}

# Iterate over all categories
for category in categories:
    # Skip categories that are not used
    if not category.AllowsBoundParameters:
        continue
    
    # Filter elements by category
    collector = FilteredElementCollector(doc).OfCategoryId(category.Id).WhereElementIsNotElementType()
    
    # Set to store unique parameter names for the category
    parameters = set()
    
    # Iterate over all elements in the category
    for element in collector:
        # Iterate over all parameters of the element
        for param in element.Parameters:
            parameters.add(param.Definition.Name)
    
    # Store the parameters in the dictionary
    if parameters:
        category_parameters[category.Name] = list(parameters)

# Convert dictionary to a list of tuples for output
category_parameters_list = [(cat, params) for cat, params in category_parameters.items()]

# Output the list of category parameters
OUT = category_parameters_list
# ----------------------------------------
python_script_2 = Python()  # CPython3; unwired: IN[0]
# ---------- python_script_2.python (32 lines) ----------
# Load the Python Standard and DesignScript Libraries
import sys
import clr
clr.AddReference('ProtoGeometry')
from Autodesk.DesignScript.Geometry import *

# The inputs to this node will be stored as a list in the IN variables.
dataEnteringNode = IN

# Place your code below this line

import clr
clr.AddReference('RevitServices')
clr.AddReference('RevitAPI')
clr.AddReference('RevitNodes')

from RevitServices.Persistence import DocumentManager
import Revit
clr.ImportExtensions(Revit.Elements)
clr.ImportExtensions(Revit.GeometryConversion)

# Access the current Revit document
doc = DocumentManager.Instance.CurrentDBDocument

# Get all categories in the document
categories = doc.Settings.Categories

# Prepare a list of category names
category_names = [category.Name for category in categories]

# Output the list of category names
OUT = category_names
# ----------------------------------------
python_script_3 = Python()  # CPython3; unwired: IN[0]
# ---------- python_script_3.python (36 lines) ----------
# Load the Python Standard and DesignScript Libraries
import sys
import clr
clr.AddReference('ProtoGeometry')
from Autodesk.DesignScript.Geometry import *

# The inputs to this node will be stored as a list in the IN variables.
dataEnteringNode = IN

# Place your code below this line

import clr
clr.AddReference('RevitServices')
clr.AddReference('RevitAPI')
clr.AddReference('RevitNodes')

from RevitServices.Persistence import DocumentManager
from Autodesk.Revit.DB import FilteredElementCollector, Element

# Access the current Revit document
doc = DocumentManager.Instance.CurrentDBDocument

# Retrieve all elements in the document
all_elements = FilteredElementCollector(doc).WhereElementIsNotElementType().ToElements()

# Prepare a list of elements with their IDs and names (if available)
elements_with_ids = []
for element in all_elements:
    try:
        name = element.Name
    except:
        name = "No Name"
    elements_with_ids.append((name, element.Id.IntegerValue))

# Output the list of elements with their IDs
OUT = elements_with_ids
# ----------------------------------------
python_script_4 = Python(IN[0]=python_script_2, IN[1]=python_script_3)  # CPython3
# ---------- python_script_4.python (41 lines) ----------
# Load the Python Standard and DesignScript Libraries
import sys
import clr
clr.AddReference('ProtoGeometry')
from Autodesk.DesignScript.Geometry import *

# The inputs to this node will be stored as a list in the IN variables.
dataEnteringNode = IN

# Place your code below this line

import clr
clr.AddReference('RevitServices')
clr.AddReference('RevitAPI')
clr.AddReference('RevitNodes')

from RevitServices.Persistence import DocumentManager
from Autodesk.Revit.DB import Element, ElementId

# Access the current Revit document
doc = DocumentManager.Instance.CurrentDBDocument

# Inputs
categories_list = IN[0]  # List of categories used in the project
elements_list = IN[1]  # List of elements with their IDs

# Prepare a list of elements with their IDs, names, and categories
elements_with_details = []

for element_info in elements_list:
    element_name, element_id = element_info
    element = doc.GetElement(ElementId(element_id))
    try:
        name = element.Name
    except:
        name = "No Name"
    category = element.Category.Name if element.Category else "No Category"
    elements_with_details.append((name, element.Id.IntegerValue, category))

# Output the list of elements with their details
OUT = elements_with_details
# ----------------------------------------
python_script_5 = Python(IN[0]=python_script, IN[1]=python_script_4)  # CPython3
# ---------- python_script_5.python (63 lines) ----------
# Load the Python Standard and DesignScript Libraries
import sys
import clr
clr.AddReference('ProtoGeometry')
from Autodesk.DesignScript.Geometry import *

# The inputs to this node will be stored as a list in the IN variables.
dataEnteringNode = IN

# Place your code below this line
import clr
clr.AddReference('RevitServices')
clr.AddReference('RevitAPI')
clr.AddReference('RevitNodes')

from RevitServices.Persistence import DocumentManager
from Autodesk.Revit.DB import Element, ElementId  # Ensure ElementId is imported

# Access the current Revit document
doc = DocumentManager.Instance.CurrentDBDocument

# Inputs
parameters_by_category = IN[0]  # List of tuples (category, list of parameters)
elements_with_details = IN[1]  # List of tuples (element name, element ID, category)

# Prepare the output list in the desired format
output_data = []

# Collect all unique parameter names
unique_parameters = set()
for cat, params in parameters_by_category:
    unique_parameters.update(params)

unique_parameters = sorted(unique_parameters)

# Define the headers based on the unique parameter names
headers = ["Category", "Element Name"] + list(unique_parameters)

# Iterate through the elements with their details
for element_detail in elements_with_details:
    element_name, element_id, category = element_detail
    
    # Find the corresponding parameters for the category
    for cat, params in parameters_by_category:
        if cat == category:
            # Get the element by its ID
            element = doc.GetElement(ElementId(element_id))
            
            # Prepare a list of parameter values
            param_values = []
            for param_name in unique_parameters:
                param = element.LookupParameter(param_name)
                if param:
                    param_values.append(param.AsValueString() if param.AsValueString() else param.AsString())
                else:
                    param_values.append("N/A")
            
            # Add the data to the output list
            output_data.append((category, element_name, param_values))
            break

# Prepare the output
OUT = (headers, output_data)
# ----------------------------------------
python_script_6 = Python(IN[0]=python_script_5)  # CPython3
# ---------- python_script_6.python (37 lines) ----------
# Load the Python Standard and DesignScript Libraries
import sys
import clr
clr.AddReference('ProtoGeometry')
from Autodesk.DesignScript.Geometry import *

# The inputs to this node will be stored as a list in the IN variables.
dataEnteringNode = IN

# Place your code below this line

import openpyxl
from openpyxl import Workbook

# Input from the previous node
headers, data = IN[0]

# Create a new Excel workbook and select the active worksheet
wb = Workbook()
ws = wb.active
ws.title = "Revit Data"

# Write headers to the first row
ws.append(headers)

# Write data to the worksheet
for item in data:
    category, element_name, param_values = item
    row = [category, element_name] + param_values
    ws.append(row)

# Save the workbook to a file
output_file_path = r"C:\Users\ntry2\OneDrive\Desktop\data transfer.xlsx"  # Your specified file path
wb.save(output_file_path)

# Output the file path for reference
OUT = output_file_path
# ----------------------------------------
file_path = Filename("..\..\excel file generated\input\data transfer for all element.xlsx")
python_script_7 = Python(IN[0]=python_script_5, IN[1]=file_path)  # CPython3
# ---------- python_script_7.python (42 lines) ----------
# Load the Python Standard and DesignScript Libraries
import sys
import clr
clr.AddReference('ProtoGeometry')
from Autodesk.DesignScript.Geometry import *

# The inputs to this node will be stored as a list in the IN variables.
dataEnteringNode = IN

# Place your code below this line

import openpyxl
from openpyxl import Workbook

# Input from the previous node
data = IN[0]

# Input for file path
output_file_path = IN[1]

# Extract headers and data
headers, data_rows = data[0], data[1]

# Create a new Excel workbook and select the active worksheet
wb = Workbook()
ws = wb.active
ws.title = "Revit Data"

# Write headers to the first row
ws.append(headers)

# Write data to the worksheet
for item in data_rows:
    category, element_name, param_values = item
    row = [category, element_name] + param_values
    ws.append(row)

# Save the workbook to a file
wb.save(output_file_path)

# Output the file path for reference
OUT = output_file_path
# ----------------------------------------
