# Dynamo graph Home.dyn (Dynamo 3.0.3.7597)

python_script = Python()  # CPython3; unwired: IN[0]
# ---------- python_script.python (75 lines) ----------
import clr
import sys
import os
import subprocess

clr.AddReference('RevitServices')
clr.AddReference('RevitAPI')
clr.AddReference('RevitNodes')
clr.AddReference('ProtoGeometry')

from RevitServices.Persistence import DocumentManager
from Autodesk.Revit.DB import FilteredElementCollector, BuiltInCategory, Element
from openpyxl import Workbook

# Function to convert square feet to square meters
def convert_to_square_meters(area_in_square_feet):
    return area_in_square_feet * 0.092903

# Function to convert cubic feet to cubic meters
def convert_to_cubic_meters(volume_in_cubic_feet):
    return volume_in_cubic_feet * 0.0283168

# Ensure the document is correctly accessed
doc = DocumentManager.Instance.CurrentDBDocument

# Collect all elements in the document
collector = FilteredElementCollector(doc).WhereElementIsNotElementType()
elements = [elem for elem in collector]

# Initialize list with headers
data = [["Element ID", "Category", "Material Name", "Volume (m³)", "Area (m²)"]]

# Extract element IDs and categorize elements
for elem in elements:
    elem_id = elem.Id.ToString()
    elem_category = elem.Category.Name if elem.Category else "Unknown"
    
    # Extract material parameters for each element
    material_set = elem.GetMaterialIds(False)
    for material_id in material_set:
        material = doc.GetElement(material_id)
        material_name = material.Name
        param_volume = elem.LookupParameter('Volume')
        param_area = elem.LookupParameter('Area')
        
        volume = convert_to_cubic_meters(param_volume.AsDouble()) if param_volume else 0
        area = convert_to_square_meters(param_area.AsDouble()) if param_area else 0
        
        data.append([elem_id, elem_category, material_name, volume, area])

# Create a new Excel workbook and select the active worksheet
wb = Workbook()
ws = wb.active
ws.title = "Material Takeoff"

# Write the data to the worksheet
for row in data:
    ws.append(row)

# Define the file path
file_path = os.path.join(os.environ["USERPROFILE"], "Documents", "material_takeoff.xlsx")

# Save the workbook to the specified file path
try:
    wb.save(file_path)
    OUT = "Export Completed"
    # Open the Excel file
    if sys.platform == "win32":
        os.startfile(file_path)
    else:
        subprocess.call(['open', file_path])
except PermissionError:
    OUT = f"PermissionError: Cannot write to the file path: {file_path}. Please choose a different location."
except Exception as e:
    OUT = f"Error: {str(e)}"
# ----------------------------------------
