# Dynamo graph Stairs Schedule using Level.dyn (Dynamo 3.0.3.7597)

categories = Categories("OST_Stairs")
all_elements_of_category = ElementsOfCategory(Category=categories)
string = StringInput("Base Level")
getParameterValueByName = Element.GetParameterValueByName(element=all_elements_of_category, parameterName=string)
groupByKey = List.GroupByKey(list=all_elements_of_category, keys=getParameterValueByName)
watch = Watch(groupByKey.groups)
watch_2 = Watch(groupByKey.uniqueKeys)
string_2 = StringInput("Mark")
levelSorting = Custom[LevelSorting]()  # level get sort based on their elevation (list start from -1)
getParameterValueByName_2 = Element.GetParameterValueByName(element=groupByKey.groups, parameterName=string)
name = Element.Name(element=getParameterValueByName_2)
valueAtKey = DesignScript.Builtin.Dictionary.ValueAtKey(dictionary=levelSorting, key=name)
number = DoubleInput(1)
count = List.Count(list=groupByKey.groups@L2)
range = Range(start=number, end=count)
string_from_object = FromObject(object=range)
number_2 = DoubleInput(3)
string_3 = StringInput("0")
padLeft = String.PadLeft(string=string_from_object, newLength=number_2, padChars=string_3)
add = valueAtKey + padLeft
setParameterByName = Element.SetParameterByName(element=groupByKey.groups, parameterName=string_2, value=add)
watch_3 = Watch(setParameterByName)
