# Dynamo graph Wall Foundation.dyn (Dynamo 3.0.3.7597)

element_classes = ElementTypes("WallFoundation")
all_elements_of_class = ElementsOfType(element_class=element_classes)
code_block = CodeBlock { "Mark"; }
number = DoubleInput(1)
id = Element.Id(element=all_elements_of_class)
count = List.Count(list=id)
sequence = Sequence(start=number, amount=count)
string_from_object = FromObject(object=sequence)
setParameterByName = Element.SetParameterByName(element=all_elements_of_class, parameterName=code_block, value=string_from_object)
element_by_id = ElementById(Id=id)
