# Dynamo graph layers.dyn (Dynamo 3.0.3.7597)

python_script = Python()  # CPython3; unwired: IN[0]
# ---------- python_script.python (80 lines) ----------
# Load the Python Standard and DesignScript Libraries
import sys
import clr
clr.AddReference('ProtoGeometry')
from Autodesk.DesignScript.Geometry import *

# The inputs to this node will be stored as a list in the IN variables.
dataEnteringNode = IN

# Place your code below this line

import clr
clr.AddReference('RevitAPI')
from Autodesk.Revit.DB import *
clr.AddReference('RevitServices')
from RevitServices.Persistence import DocumentManager

import openpyxl
from openpyxl import Workbook
import os

doc = DocumentManager.Instance.CurrentDBDocument

def get_elements_with_compound_structure(doc):
    categories = [
        BuiltInCategory.OST_Walls,
        BuiltInCategory.OST_Floors,
        BuiltInCategory.OST_Roofs,
        BuiltInCategory.OST_Ceilings
    ]
    elements = []
    for category in categories:
        collector = FilteredElementCollector(doc).OfCategory(category).WhereElementIsNotElementType()
        elements.extend(collector.ToElements())
    return elements

# Prepare Excel file
excel_path = r"C:\Users\ntry2\OneDrive\Desktop\New folder (6)\excel file generated\input\element with layer quantity takeoff.xlsx"
wb = Workbook()
ws = wb.active
ws.title = "Layer Properties"
headers = ["Element ID", "Category", "Family", "Type", "Name", "Function", "Material", "Thickness", "Wraps", "Variable"]
ws.append(headers)

# Get all elements with compound structure
elements = get_elements_with_compound_structure(doc)

# Process each element
for element in elements:
    element_type = doc.GetElement(element.GetTypeId())
    
    # Get element properties
    element_id = element.Id.IntegerValue
    category = element.Category.Name
    family = element_type.FamilyName
    type_name = element_type.LookupParameter("Type Name").AsString()
    name = element.Name
    
    # Get compound structure
    if hasattr(element_type, "GetCompoundStructure"):
        compound_structure = element_type.GetCompoundStructure()
        if compound_structure:
            layers = compound_structure.GetLayers()
            
            for layer in layers:
                function = str(layer.Function)  # Convert enum to string
                material_id = layer.MaterialId
                material = doc.GetElement(material_id).Name if material_id != ElementId.InvalidElementId else ""
                thickness = str(layer.Width)  # Convert to string explicitly
                wraps = "Yes" if hasattr(layer, "DeckEmbedded") and (layer.DeckEmbedded or layer.DeckProfiled) else "No"
                variable = "Yes" if hasattr(layer, "IsVariable") and layer.IsVariable else "No"
                
                # Write data to Excel
                ws.append([element_id, category, family, type_name, name, function, material, thickness, wraps, variable])

# Save the Excel file, overwriting any existing file
wb.save(excel_path)

# Output success message
OUT = "Layer details for all applicable elements exported to " + excel_path
# ----------------------------------------
